# Grasshopper definition TestFile.gh (Grasshopper 1.0.4)
# plug-ins: CurvedCreaseFolding

rectangle = Rectangle(Plane=PlaneXY(0, 0, 0), XSize="0 to 10", YSize="0 to 10", Radius=0)  # -> Rectangle, Length
number_slider = Slider(5, range=0..10)
mplane = MeshPlane(Boundary=rectangle.Rectangle, WidthCount=number_slider, HeightCount=number_slider)  # -> Mesh, Area
mesh = Mesh(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)
crvcrsfld = CurvedCreaseFolding(Mesh=mplane.Mesh, Degree=Slider(0.433, range=0..1))

# ---- group: output
mesh_2 = Mesh(crvcrsfld)

# ----
material = CreateMaterial(
    Diffuse=ColourSwatch(SwatchColor=RGB(0, 255, 229)),
    Specular=RGB(255, 255, 255),
    Emission=ColourSwatch(SwatchColor=RGB(0, 84, 76)),
    Transparency=Slider(0.3, range=0..1),
    Shine=Slider(61, range=0..100))
preview = CustomPreview(Geometry=mesh_2, Material=material)
